vi "New Layer Prompt.gvi"   [LabVIEW NXG 5.0.0]
inputs:
  "Error In": error
outputs:
  "Error Out": error
panel controls:
  "Layer Type": T1 = "Front Electrode"
  "Deposition Method": T2 = "Blade Coating"
  "Blade Coating Controls": T3
  "Solution Information": T4
  "Spin Coating Controls": T5
  "Thermal Evaporation Controls": T6
  "General Controls": T7
  "Add Layer Button": bool
  "Misc Data Mega Cluster In": "Misc Mega Cluster.gtype"
types:
  T1 = enum{"Front Electrode", "Electrode Transport Layer", "Active Layer", "Hole Transport Layer", "Back Electrode", "Annealing Treatment", "Encapsulation", "Custom Layer"}
  T2 = enum{"Blade Coating", "Spin Coating", "Thermal Evaporation", "E-beam Evaporation", "Sputtering", "Drop Casting", "Dip Coating", "Pulsed Laser Deposition", "Chemical Vapour Deposition", "Atomic Layer Deposition", "Spray Coating", "Screen Printing", "Electroplating", "Molecular Beam Epitaxy", "Custom Deposition"}
  T3 = cluster{"Thickness (nm)": f64, "Blade Initial Speed (mm/s)": f64, "Speed Gradient": bool, "Blade Final Speed (mm/s)": f64, "Blade Gap (um)": f64, "Blade Temperature (ºC)": f64, "Droplet Volume (ul)": f64, "Subsequent layers": f64, "Glovebox": bool, "Comments": string}
  T4 = cluster{"Concentration (mg/ml)": f64, "Stirring Time (kr)": f64, "Glovebox": bool, "Composition Array": cluster{"Material": string, "Ratio": f64}[], "Solvent Array": cluster{"Solvent": string, "Ratio": f64}[], "Solution Preparation Date": f64}
  T5 = cluster{"Thickness (nm)": f64, "Spin Speed (rpm)": f64, "Dynamic Deposition": bool, "Spin Acceleration (rpm/s)": f64, "Droplet Volume (ul)": f64, "Subsequent layers": f64, "Glovebox": bool, "Comments": string}
  T6 = cluster{"Thickness (nm)": f64, "Deposition Rate (nm/s)": f64, "Comments": string, "Sample Rotation": bool}
  T7 = cluster{"Thickness (nm)": f64, "Comments": string}
  T8 = cluster{"State Ref": "StringControl reference", "Substate Ref": "StringControl reference", "Current State Ref": "EnumSelector reference", "Main Tab Ref": "TabControl reference", "Plot Now Flag Ref": "BooleanControl reference"}
  T9 = cluster{"Default Data Saving Location Ref": "PathSelector reference"}
  T10 = cluster{"Author Initials Ref": "ComboBoxSelector reference", "Batch Name Ref": "StringControl reference", "Cell Number Ref": "StringControl reference", "Current Date Ref": "StringControl reference", "Sample Comments Ref": "StringControl reference", "Sample Prefix Ref": "StringControl reference", "Custom Date Ref": "CheckBox reference", "Label Info Error Label Ref": "StringControl reference", "Label Info Missing Error Ref": "BooleanControl reference"}
  T11 = cluster{"Cell Parameters Ref": "Cluster reference", "Cell Selector Ref": "Cluster reference", "Measurement Precision Ref": "Cluster reference", "JV Scan Mode Ref": "EnumSelector reference"}
  T12 = cluster{"Progress % Ref": "ProgressBar reference", "Progress Counter Ref": "NumericTextBoxDouble reference", "Live JV Parameters Ref": "Cluster reference"}
  T13 = cluster{"Layer Information Ref": "ArrayViewer reference"[]}
  T14 = cluster{"Cell Selector Block Ref": "Rectangle reference", "Smart Mode Block Ref": "Rectangle reference", "dV Block Ref": "Rectangle reference", "Smart Mode Text Ref": "Text reference", "No Multiplexer Detected Text Ref": "Text reference"}
  T15 = cluster{"JV Measurements Mega Cluster Ref": "Cluster reference", "Instrument Control Mega Cluster Ref": "Cluster reference"}
  T16 = cluster{"JV Main Graph Ref": "Graph reference", "Voc Graph Ref ": "Graph reference", "Jsc Graph Ref": "Graph reference", "Efficiency Graph Ref": "Graph reference", "Fill Factor Graph Ref": "Graph reference", "Series Resistance Graph Ref": "Graph reference", "Shunt Resistance Graph Ref": "Graph reference"}
  "Full Reference Cluster.gtype" = cluster{"Status Report": T8, "Path Cluster": T9, "Sample Naming Cluster": T10, "Acquisition Parameters": T11, "Live Progress Cluster": T12, "Sample Extra Information": T13, "Visual Elements": T14, "Mega Cluster References": T15, "Plotting": T16, "System Parameters": cluster{"Main VI Ref": VIRefnum}}
  "Misc Mega Cluster.gtype" = cluster{"Full Reference Cluster": "Full Reference Cluster.gtype"}
  "New Layer Prompt Ref Cluster.gtype" = cluster{"Add Layer Button Ref": "BooleanControl reference", "Blade Coating Controls Ref": "Cluster reference", "Deposition Method Ref": "EnumSelector reference", "General Controls Ref": "Cluster reference", "Layer Type Ref": "EnumSelector reference", "Solution Information Ref": "Cluster reference", "Spin Coating Controls Ref": "Cluster reference", "Thermal Evaporation Controls Ref": "Cluster reference", "This VI Ref": VIRefnum}
uses:
  Pika IV Characterization NXG::Main Functions::Layer Composition::Check and Set Control Visibility.gvi
diagram:
  case ($"Error In") {
    frame Error, Default {
      w1 = $"Error In"
    }
    frame No Error {
      This VI Reference() -> (reference out=w2)
      Property Node(instance in="New Layer Prompt Ref Cluster.gtype" {all zero or empty}, "Add Layer Button Ref"=reference to "Add Layer Button", "Blade Coating Controls Ref"=reference to "Blade Coating Controls", "Deposition Method Ref"=reference to "Deposition Method", "General Controls Ref"=reference to "General Controls", "Layer Type Ref"=reference to "Layer Type", "Solution Information Ref"=reference to "Solution Information", "Spin Coating Controls Ref"=reference to "Spin Coating Controls", "Thermal Evaporation Controls Ref"=reference to "Thermal Evaporation Controls", "This VI Ref"=w2) -> (instance out=w3)
      This VI Reference() -> (reference out=w4)
      Property Node(instance in=w4, error in=$"Error In") -> ("Panel"=w5, error out=w6)
      Property Node(instance in=w5, error in=w6) -> ("Window"=w7, error out=w8)
      Open Window(reference in=w7, error in=w8) -> (error out=w9)
      Property Node(instance in=reference to "Deposition Method", "ValueSignaling"="Blade Coating", error in=w9) -> (error out=w10)
      s1 = w10  # shift register
      s2 = w3  # shift register
      while {
        event (timeout = 50) {
          on "Timeout" {
            w11 = s1
            w12 = s2
            w13 = default
          }
          on "Deposition Method" Value changed {
            call "Check and Set Control Visibility.gvi"(New Layer Prompt Ref Cluster In=s2, Error In=s1) -> (New Layer Prompt Ref Cluster Out=w12, Error Out=w11)
            w13 = default
          }
          on "Add Layer Button" Value changed {
            w11 = s1
            w12 = s2
            w13 = TRUE
          }
        }
        next s1 = w11
        next s2 = w12
        stop if w13
      }
      w1 = s1
    }
  }
  $"Error Out" <- w1
